# Grasshopper definition attractor points_re.gh (Grasshopper 1.0.5)

number_slider = Slider(36, range=0..100)
srf = Surface(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)

# ---- group: Attractor Points
pt = Point([Point(-3.081125363, 1.587209805, 0), Point(2.819120865, 7.3795247, 0), Point(9.151092428, 2.558591806, 0)])

# ----
sdivide = DivideSurface(Surface=srf, UCount=number_slider, VCount=Slider(19, range=0..100))  # -> Points, Normals, Parameters
dist = Distance(PointA=flatten(sdivide.Points), PointB=graft(pt))
dots = DotDisplay(Point=pt, Colour=RGB(255, 255, 0), Size=0.3)
flip = FlipMatrix(Data=dist)
sort = SortList(Keys=flip)  # -> Keys, ValuesA
item = ListItem(List=sort.Keys, Index=0, Wrap=True)
flip_2 = FlipMatrix(Data=item)
bnd = Bounds(Numbers=flip_2)
remap = RemapNumbers(Value=flip_2, Source=bnd, Target=Domain(0, 1))  # -> Mapped, Clipped
graph = GraphMapper(remap.Mapped, x0=0, x1=1, y0=0, y1=1, container_name="Bezier", cpx=[0, 0.2863048613, 0, 1], cpy=[1, 0.8338438869, 0, 0])
bnd_2 = Bounds(Numbers=graph)
dom = ConstructDomain(DomainStart=Slider(0, range=0..5), DomainEnd=Slider(3.681, range=0..5))
remap_2 = RemapNumbers(Value=graph, Source=bnd_2, Target=dom)  # -> Mapped, Clipped
unflatten = UnflattenTree(Tree=remap_2.Clipped, Guide=sdivide.Points)
Z = UnitZ(Factor=unflatten)
expression = Expression(u=number_slider, Expression="u+1")
move = Move(Geometry=sdivide.Points, Motion=Z)  # -> Geometry, Transform

srfgrid = SurfaceFromPoints(Points=flatten(move.Geometry), UCount=expression, Interpolate=False)
preview = CustomPreview(
    Geometry=srfgrid,
    Material={diffuse=RGB(221, 160, 221), emission=RGB(66, 48, 66), shine=0.5, specular=RGB(255, 255, 255), transparency=0})
