# Grasshopper definition multipleattractorcurves_revised.gh (Grasshopper 0.9.76)

number_slider = Slider(100, range=2..100)
number_slider_2 = Slider(100, range=2..100)

# ---- group: attractor curve
crv = Curve(reparameterize(graft([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])))

# ---- group: base surface
srf = Surface(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)

srf_2 = Surface(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)

# ---- group: attractor curve
crv_2 = Curve(reparameterize(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))

# ----
crv_3 = Curve(reparameterize(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))
sdivide = DivideSurface(Surface=srf, UCount=number_slider, VCount=Slider(100, range=2..100))  # -> flatten(Points), Normals, Parameters
sdivide_2 = DivideSurface(Surface=srf_2, UCount=number_slider_2, VCount=Slider(100, range=2..100))  # -> flatten(Points), Normals, Parameters
crv_cp = CurveClosestPoint(Point=sdivide.Points, Curve=crv)  # -> Point, Parameter, Distance
crv_cp_2 = CurveClosestPoint(Point=sdivide_2.Points, Curve=crv_3)  # -> Point, Parameter, Distance
crv_cp_3 = CurveClosestPoint(Point=sdivide_2.Points, Curve=crv_2)  # -> Point, Parameter, Distance
graph = GraphMapper(
    crv_cp.Distance,
    x0=0,
    x1=15,
    y0=0,
    y1=6,
    container_name="Bezier",
    cpx=[0, 0.6040835977, 0.3918390572, 1],
    cpy=[1, 1, 0, 0])
graph_2 = GraphMapper(
    crv_cp_2.Distance,
    x0=0,
    x1=15,
    y0=0,
    y1=6,
    container_name="Bezier",
    cpx=[0, 0.6040835977, 0.3918390572, 1],
    cpy=[1, 1, 0, 0])
graph_3 = GraphMapper(crv_cp.Parameter, x0=0, x1=1, y0=0, y1=1, container_name="Sine", Equation_px=[0, 0.4952384233], Equation_py=[0, 1])
graph_4 = GraphMapper(
    crv_cp_3.Distance,
    x0=0,
    x1=15,
    y0=0,
    y1=6,
    container_name="Bezier",
    cpx=[0, 0.6040835977, 0.3918390572, 1],
    cpy=[1, 1, 0, 0])
graph_5 = GraphMapper(crv_cp_2.Parameter, x0=0, x1=1, y0=0, y1=1, container_name="Sine", Equation_px=[0, 0.4952384233], Equation_py=[0, 1])
graph_6 = GraphMapper(crv_cp_3.Parameter, x0=0, x1=1, y0=0, y1=1, container_name="Sine", Equation_px=[0, 0.4952384233], Equation_py=[0, 1])
multiplication = Multiplication(A=graph_3, B=graph)
multiplication_2 = Multiplication(A=graph_5, B=graph_2)
multiplication_3 = Multiplication(A=graph_6, B=graph_4)

flip = FlipMatrix(Data=multiplication)
ma = MassAddition(Input=flip)  # -> Result, PartialResults
num = Number(flatten(ma.Result))

Z = UnitZ(Factor=num)
addition = Addition(A=multiplication_3, B=multiplication_2)
Z_2 = UnitZ(Factor=addition)
addition_2 = Addition(A=sdivide.Points, B=Z)
addition_3 = Addition(A=sdivide_2.Points, B=Z_2)
srfgrid = SurfaceFromPoints(Points=addition_2, UCount=expr("x+1", number_slider), Interpolate=False)
srfgrid_2 = SurfaceFromPoints(Points=addition_3, UCount=expr("x+1", number_slider_2), Interpolate=False)
